# Dynamo graph Dimension Beam section.dyn (Dynamo 2.12.1.8246)
# packages: Genius Loci 2022.7.5

current = Document.Current()
activeView = Document.ActiveView(document=current)
beam = DSModelElementSelection()  # 1 picked in the model; graph input
location = StructuralFraming.Location(structuralFraming=beam)
startPoint = Curve.StartPoint(curve=location)
code_block = CodeBlock { 300; }
translate = Geometry.Translate(geometry=startPoint, zTranslation=code_block)
byStartPointEndPoint = Line.ByStartPointEndPoint(startPoint=startPoint, endPoint=translate)
code_block_2 = CodeBlock { 550; }
translate_2 = Geometry.Translate(geometry=byStartPointEndPoint, yTranslation=code_block_2)
level = DSModelElementSelection()  # 1 picked in the model; graph input
element_reference = Custom[Element Reference](element=level)  # package Genius Loci; Gets the reference of a geometric object or a dimension or a reference plane.
familyinstance_referencetype = Custom[FamilyInstance ReferenceType]()  # package Genius Loci; Works only in Revit 2018.1 and later. Identifies references of family instances corresponding to reference planes and reference lines in the family.
string_from_object = FromObject(object=familyinstance_referencetype)
string = StringInput("Top")
indexOf = List.IndexOf(list=string_from_object, element=string)
getItemAtIndex = List.GetItemAtIndex(list=familyinstance_referencetype, index=indexOf)
familyinstance_reference = Custom[FamilyInstance Reference ByRefLine](familyInstance=beam, ReferenceType=getItemAtIndex)  # package Genius Loci; Works only in Revit 2018.1 and later. Gets the reference corresponding to the given Reference Line in the family instance.
join = List.Join(list0=element_reference, list1=familyinstance_reference)
dimension_byreferences = Custom[Dimension ByReferences](view=activeView, line=translate_2, references=join)  # package Genius Loci; Creates a new linear dimension from at least two geometric references of an object.
