# Dynamo graph SectionView.dyn (Dynamo 2.1.0.7500)

# group: Select Walls
select_model_elements = DSModelElementsSelection()  # 6 picked in the model

# group: Wall Curve
getLocation = Element.GetLocation(element=select_model_elements)

# group: Origin"
code_block = CodeBlock { 0.5; }
pointAtParameter = Curve.PointAtParameter(curve=getLocation, param=code_block)

# group: X"
direction = Line.Direction(line=getLocation)
normalized = Vector.Normalized(vector=direction)

# group: Y"
ZAxis = Vector.ZAxis()

# group: Z"
cross = Vector.Cross(vector=normalized, cross=ZAxis)

# group: New CS
byOriginVectors = CoordinateSystem.ByOriginVectors(origin=pointAtParameter, xAxis=normalized, yAxis=ZAxis, zAxis=cross)

# group: Wall Length, L
length = Curve.Length(curve=getLocation)

# group: MinPt
code_block_2 = CodeBlock(length=length) { -length/2; -500; }
byCoordinates = Point.ByCoordinates(x=code_block_2.out0, z=code_block_2.out1)

# group: Wall Height, H
code_block_3 = CodeBlock(wallElements=select_model_elements) { wallElements; }
code_block_4 = CodeBlock { "Unconnected Height"; }
getParameterValueByName = Element.GetParameterValueByName(element=code_block_3, parameterName=code_block_4)

# group: MaxPt
code_block_5 = CodeBlock(length=length) { length/2; 500; }
byCoordinates_2 = Point.ByCoordinates(x=code_block_5.out0, y=getParameterValueByName, z=code_block_5.out1)

# group: Create Sections!
byCoordinateSystemMinPointMaxPoint = SectionView.ByCoordinateSystemMinPointMaxPoint(cs=byOriginVectors, minPoint=byCoordinates, maxPoint=byCoordinates_2)
