# Dynamo graph new Column section.dyn "Column section" (Dynamo 2.12.1.8246)
# packages: BIM4Struc.Productivity 2.2.2

XAxis = Vector.XAxis()
YAxis = Vector.YAxis()
reverse = Vector.Reverse(vector=YAxis)
list_create = List.Create(item0=XAxis, item1=XAxis, item2=reverse)
ZAxis = Vector.ZAxis()
list_create_2 = List.Create(item0=reverse, item1=ZAxis, item2=ZAxis)
code_block = CodeBlock { 500; }
code_block_2 = CodeBlock { 1000; }
select_model_element = DSModelElementSelection()  # 1 picked in the model; graph input

# group: Definition of the view names
code_block_3 = CodeBlock { "Mark"; }
getParameterValueByName = Element.GetParameterValueByName(element=select_model_element, parameterName=code_block_3)
code_block_4 = CodeBlock(Suffix=getParameterValueByName) { "Cross - " + Suffix; }
code_block_5 = CodeBlock(Suffix=getParameterValueByName) { "1 - " + Suffix; }
code_block_6 = CodeBlock(Suffix=getParameterValueByName) { "2 - " + Suffix; }
y_vector_list_create = List.Create(item0=code_block_4, item1=code_block_5, item2=code_block_6)
flatten = List.Flatten(list=y_vector_list_create)

# group: Element subsets
count = List.Count(list=y_vector_list_create)
# note: Create sublists of elements, so it fits with the number of view types that need to be generated.
cycle = List.Cycle(list=select_model_element, amount=count)

# group: Views Center Point (solid centroid)
solids = Element.Solids(element=cycle)
flatten_2 = List.Flatten(list=solids)

centroid = Solid.Centroid(solid=flatten_2)
create_element_view = Custom[Create Element View](Xvector=list_create, Yvector=list_create_2, CropRegionOffset=code_block, ViewDepth=code_block_2, CSPoint=centroid, RevitElements=cycle, Viewname=flatten)  # package BIM4Struc.Productivity; This node makes it possible to automatically create aligned section views on selected elements. Necessary inputs are: Revit Elements: this to detect the solid.centroid. The views are oriented to that point. X-vectors and Y-vectors to get the direction of the section plane. Traditionally these vectors are taken from the location lines of linear objects or facing directions of generic elements (i.e. doors). You might replace this with the vector of a selected edge for instance.
